% Simulink data dictionary rev3_data.sldd

MC_DC_State = enum(DefaultValue="Disabled")
  Disabled = 0
  Enabled = 1
  Speed_Check = 2
  Active = 3
  Complete = 4

MC_VSM_State = enum(DefaultValue="Start")
  Start = 0
  PC_Init = 1
  PC_Active = 2
  PC_Finish = 3
  Wait = 4
  Ready = 5
  Motor_Running = 6
  Fault = 7
  Shutdown = 14
  Recycle_Power = 15

BMS_Contactor_Command = enum(DefaultValue="Open_Contactor")
  Open_Contactor = 0
  Close_Contactor = 1
  Stay = 2

UC_State = enum(DefaultValue="Preset")
  Preset = 0
  Key_Cycle = 1
  MC_Off = 2
  LVSS_MC_Startup = 3
  MC_Init = 4
  Contactor_Closed = 5
  MC_Ready = 6
  Contactor_Open = 7
  MC_Discharging = 8
  LVSS_MC_Shutdown = 9
  MC_Active = 10
  Estop = 11
  Fault = 12
  Super_Fault = 13

Sig = Simulink.Signal()
Sig1 = Simulink.Signal()
Sig2 = Simulink.Signal()

BMS = Simulink.Bus()
  BMS_EN: boolean
  Override_BMS_EN: boolean
  BMS_Contactor_State: Enum: BMS_Contactor_Command
  Override_BMS_Contactor_State: boolean
  BMS_Previous_State: boolean
  Override_BMS_Previous_State: boolean
  Cell_Temps: double
  Override_Cell_Temps: boolean
  Cell_Voltages: double
  Override_Cell_Voltages: boolean

Rider_Inputs = Simulink.Bus()
  Yes_HIB: Bus: Yes_HIB
  No_HIB: Bus: No_HIB

GFDB = Simulink.Bus()
  GFDB_EN: boolean
  Override_GFDB_EN: boolean
  Fault_Value: double
  Override_Isolation_State: boolean

HIB = Simulink.Bus()
  HIB_EN: boolean
  Override_HIB_EN: boolean
  Throttle: double
  Override_Throttle: boolean
  Brake: double
  Override_Brake: boolean
  Start: boolean
  Override_Start: boolean
  Forward_EN: boolean
  Override_Forward_EN: boolean
  Comparison_Error_Count: double
  Override_Comparison_Error_Count: boolean
  Acceptable_Margin_Error_Count: double
  Override_Acceptable_Margin_Error_Count: boolean
  Precision_Margin_Error_Count: double
  Override_Precision_Margin_Error_Count: boolean

TMS = Simulink.Bus()
  TMS_EN: boolean
  Override_TMS_EN: boolean
  MC_Speed: double
  Override_MC_Speed: boolean
  Batt_Speed: double
  Override_Batt_Speed: boolean
  Temperatures: double
  Override_Temperatures: boolean
  Batt_Flow_Rate: double
  Override_Batt_FR: boolean
  MC_Flow_Rate: double
  Override_MC_FR: boolean

Sig3 = Simulink.Signal()

VCU = Simulink.Bus()
  Override_Ignition: boolean
  Ignition: boolean
  Override_ESTOP: boolean
  ESTOP: boolean
  Override_Brake: boolean
  Brake: boolean
  Override_Forward_EN: boolean
  Forward_EN: boolean
  Override_Start: boolean
  Start: boolean
  Override_Throttle: boolean
  Throttle: double
  Override_HIB_Comparison_Fault: boolean
  HIB_Comparison_Fault: boolean
  Override_Interlock: boolean
  Interlock: boolean
  Override_Inverter_Discharge_State: boolean
  Inverter_Discharge_State: Enum: MC_DC_State
  Override_VSM_State: boolean
  VSM_State: Enum: MC_VSM_State
  Override_LVSS_ON: boolean
  LVSS_ON: boolean
  Override_Contactor_Closed: boolean
  Contactor_Closed: boolean
  Override_Cell_Temps: boolean
  Cell_Temps: double
  Override_Cell_Voltages: boolean
  Cell_Voltages: double
  Override_Isolation_State: boolean
  Isolation_State: double
  Override_MC_Speed_Out: boolean
  MC_Speed_Out: double
  Override_Batt_Speed_Out: boolean
  Batt_Speed_Out: double
  Override_Temperatures: boolean
  Temperatures: double
  Override_MC_Flow_Rate: boolean
  MC_Flow_Rate: double
  Override_Batt_Flow_Rate: boolean
  Batt_Flow_Rate: double
  Override_HIB_ON: boolean
  HIB_ON: boolean
  Override_HUDL_ON: boolean
  HUDL_ON: boolean
  Override_TMS_ON: boolean
  TMS_ON: boolean
  Override_GUB_ON: boolean
  GUB_ON: boolean
  Override_Acc_ON: boolean
  Acc_ON: boolean
  Override_Batt_12V_ON: boolean
  Batt_12V_ON: boolean
  Override_Vicor_Current: boolean
  Vicor_Current: double
  Override_LVSS_Temps: boolean
  LVSS_Temps: double
  Override_LVSS_Currents: boolean
  LVSS_Currents: double
  Override_Heartbeats: boolean
  Heartbeats: double
  Override_MC_12V0: boolean
  MC_12V0: boolean
  Override_LVSS_EN: boolean
  LVSS_EN: boolean
  Override_nReset: boolean
  nReset: boolean
  Override_Self_Test: boolean
  Self_Test: double
  Override_Watchdog: boolean
  Watchdog: boolean
  Override_uC_State: boolean
  uC_State: Enum: UC_State
  Override_HB_Feedback: boolean
  HB_Feedback: boolean
  Override_HM_Fault: boolean
  HM_Fault: boolean
  Direction_Command: int16
  Override_Direction_Command: boolean
  Rolling_Counter: int16
  Override_Rolling_Counter: boolean
  Speed_Command: int16
  Override_Speed_Command: boolean
  Speed_Mode_Enable: int16
  Override_Speed_Mode_Enable: boolean
  Torque_Limit_Command: int16
  Override_Torque_Limit_Command: boolean
  LS_Self_Test: boolean
  Override_LS_Self_Test: boolean
  MC_Self_Test: boolean
  Override_MC_Self_Test: boolean
  CAN_Self_Test: boolean
  Override_CAN_Self_Test: boolean
  LVSS_EN_Override: boolean
  Override_LVSS_EN_Override: boolean
  MC_EN_Override: boolean
  Override_MC_EN_Override: boolean
  CAN_Override: boolean
  Override_CAN_Override: boolean

LVSS = Simulink.Bus()
  LVSS_EN: boolean
  Override_LVSS_EN: boolean
  TMS_EN: boolean
  Override_TMS_EN: boolean
  GUB_EN: boolean
  Override_GUB_EN: boolean
  HIB_EN: boolean
  Override_HIB_EN: boolean
  HUDL_EN: boolean
  Override_HUDL_EN: boolean
  Acc_EN: boolean
  Override_Acc_EN: boolean
  Batt_12V_EN: boolean
  Override_Batt_12V_EN: boolean
  Vicor_Current: double
  Override_Vicor_Current: boolean
  TMS_Temp: double
  Override_TMS_Temp: boolean
  TMS_Current: double
  Override_TMS_Current: boolean
  HIB_Temp: double
  Override_HIB_Temp: boolean
  HIB_Current: double
  Override_HIB_Current: boolean
  HUDL_Temp: double
  Override_HUDL_Temp: boolean
  HUDL_Current: double
  Override_HUDL_Current: boolean
  GUB_Temp: double
  Override_GUB_Temp: boolean
  GUB_Current: double
  Override_GUB_Current: boolean
  Batt_12V_Temp: double
  Override_Batt_12V_Temp: boolean
  Batt_12V_Current: double
  Override_Batt_12V_Current: boolean
  Acc_Temp: double
  Override_Acc_Temp: boolean
  Acc_Current: double
  Override_Acc_Current: boolean
  LVSS_Currents: double
  Override_LVSS_Currents: boolean
  LVSS_Temps: double
  Override_LVSS_Temps: boolean

Motor_Outputs = Simulink.Bus()
  Torque: int16

MC_Outputs = Simulink.Bus()
  MC_Command: Bus: MC_Command
  Fault_To_MC: boolean
  MC_12V0: boolean

External_Inputs = Simulink.Bus()
  No_HIB: Bus: No_HIB
  Yes_HIB: Bus: HIB_Outputs

Yes_HIB = Simulink.Bus()
  Forward_EN: boolean
  Start: boolean
  Brake: double
  Throttle: int16

HIB_Outputs = Simulink.Bus()
  HIB_Comparison_Fault: boolean
  HIB_Heartbeat: uint32
  Forward_EN: boolean
  Start: boolean
  Brake: boolean
  Throttle: int16

MC_Command = Simulink.Bus()
  Direction_Command: int16
  Rolling_Counter: int16
  Speed_Command: int16
  Speed_Mode_Enable: int16
  Torque_Limit_Command: int16

TMS_Outputs = Simulink.Bus()
  MC_Speed: uint8
  Batt_Speed: uint8

MC_Feedback = Simulink.Bus()
  D1_VSM_State: Enum: MC_VSM_State
  D4_Inverter_Discharge_State: Enum: MC_DC_State

LVSS_Outputs = Simulink.Bus()
  HIB_Power: boolean
  HUDL_Power: boolean
  TMS_Power: boolean
  GUB_Power: boolean
  Acc_Power: boolean
  Batt_12V_Power: boolean

Feedback_Input = Simulink.Bus()
  MC_Feedback: Bus: MC_Feedback
  LVSS_Outputs: Bus: LVSS_Outputs
  LVSS_Feedback: Bus: LVSS_Feedback
  BMS_Feedback: Bus: BMS_Feedback
  TMS_Feedback: Bus: TMS_Feedback
  GFDB_Feedback: Bus: GFDB_Feedback

Outputs_LVSS = Simulink.Bus()
  HIB_EN: boolean
  HUDL_EN: boolean
  TMS_EN: boolean
  GUB_EN: boolean
  Acc_EN: boolean
  Batt_12V_EN: boolean
  LVSS_EN: boolean

Outputs_VCU = Simulink.Bus()
  MC_Outputs: Bus: MC_Outputs
  Inverter_Enable: boolean
  LVSS_Outputs: Bus: Outputs_LVSS
  TMS_Outputs: Bus: TMS_Outputs
  VCU_Outputs: Bus: VCU_Outputs

LVSS_Feedback = Simulink.Bus()
  HIB_ON: boolean
  HUDL_ON: boolean
  TMS_ON: boolean
  GUB_ON: boolean
  Acc_ON: boolean
  Batt_12V_ON: boolean
  Vicor_Current: int16
  LVSS_ON: boolean
  LVSS_Temps: double[1 6]
  LVSS_Currents: double[1 6]
  LVSS_Heartbeat: uint32

BMS_Feedback = Simulink.Bus()
  BMS_Heartbeat: uint32
  Cell_Voltages: double[1 100]
  Cell_Temps: double[1 45]
  Contactor_Closed: boolean

TMS_Feedback = Simulink.Bus()
  Batt_Flow_Rate: double
  MC_Flow_Rate: double
  TMS_Heartbeat: uint32
  Temperatures: double[1 5]
  Batt_Speed_Out: double
  MC_Speed_Out: double

GFDB_Feedback = Simulink.Bus()
  Isolation_State: double
  GFDB_Heartbeat: uint32

Key_In = Simulink.Bus()
  LS_A: boolean
  LS_B: boolean

Estop_In = Simulink.Bus()
  LS_A: boolean
  LS_B: boolean

No_HIB = Simulink.Bus()
  Key_In: boolean
  Estop_In: boolean

Internal_Feedback = Simulink.Bus()
  MC_12V0: boolean
  LVSS_EN_uC: boolean
  nReset: boolean
  Watchdog: double
  uC_State: Enum: UC_State
  CAN_Override: boolean
  LVSS_EN_Override: boolean
  MC_EN_Override: boolean
  MC_Self_Test: boolean
  CAN_Self_Test: boolean
  LS_Self_Test: Bus: LS_Self_Test

VCU_HIB = Simulink.Bus()
  HIB_Comparison_Fault: boolean

LS_Self_Test = Simulink.Bus()
  LS_A: boolean
  LS_B: boolean

MCuC_Inputs = Simulink.Bus()
  Rider_Inputs: Bus: Rider_Inputs_VCU
  Feedback: Bus: Feedback
  HIB: Bus: VCU_HIB
  Interlock: boolean
  MC_Direction_Command: double
  MC_Rolling_Counter: double
  MC_Speed_Command: double
  MC_Speed_Mode_Enable: double
  MC_Torque_Limit_Command: double

CAN = Simulink.Bus()
  Inverter_EN: boolean
  Fault_To_MC: boolean
  Inverter_DC: boolean
  Torque_Request: int16
  BMS_Contactor_Command: Enum: BMS_Contactor_Command
  MC_PS_Request: uint8
  Batt_PS_Request: uint8
  HIB_EN: boolean
  HUDL_EN: boolean
  TMS_EN: boolean
  GUB_EN: boolean
  Acc_EN: boolean
  Batt_12V_EN: boolean
  Direction_Command: int16
  Rolling_Counter: int16
  Speed_Command: int16
  Speed_Mode_EN: int16
  Torque_Limit_Command: int16
  Shutdown: boolean

VCU_Outputs = Simulink.Bus()
  Inverter_Discharge: boolean
  BMS_Contactor_Command: Enum: BMS_Contactor_Command
  Torque_Command: int16
  Fault_To_MC: boolean
  Inverter_Enable: boolean
  Shutdown: boolean

WSS = Simulink.Bus()
  Wheel_Speed: double
  Override_Wheel_Speed: boolean
  Acc_EN: double
  Override_Acc_EN: boolean

Fault_Inputs = Simulink.Bus()
  VCU: Bus: VCU
  BMS: Bus: BMS
  GFDB: Bus: GFDB
  TMS: Bus: TMS
  HIB: Bus: HIB
  LVSS: Bus: LVSS
  WSS: Bus: WSS
  IMU: Bus: IMU
  TCS: Bus: TCS

IMU = Simulink.Bus()
  Wheel_Speed: double
  Override_Wheel_Speed: boolean
  Acc_EN: double
  Override_Acc_EN: boolean

TCS = Simulink.Bus()
  Override_Ignition: boolean
  Ignition: boolean
  Override_ESTOP: boolean
  ESTOP: boolean
  Override_Brake: boolean
  Brake: boolean
  Override_Forward_EN: boolean
  Forward_EN: boolean
  Override_Start: boolean
  Start: boolean
  Override_Throttle: boolean
  Throttle: double
  Override_HIB_Comparison_Fault: boolean
  HIB_Comparison_Fault: boolean
  Override_Interlock: boolean
  Interlock: boolean
  Override_Inverter_Discharge_State: boolean
  Inverter_Discharge_State: Enum: MC_DC_State
  Override_VSM_State: boolean
  VSM_State: Enum: MC_VSM_State
  Override_LVSS_ON: boolean
  LVSS_ON: boolean
  Override_Contactor_Closed: boolean
  Contactor_Closed: boolean
  Override_Cell_Temps: boolean
  Cell_Temps: double
  Override_Cell_Voltages: boolean
  Cell_Voltages: double
  Override_Isolation_State: boolean
  Isolation_State: double
  Override_MC_Speed_Out: boolean
  MC_Speed_Out: double
  Override_Batt_Speed_Out: boolean
  Batt_Speed_Out: double
  Override_Temperatures: boolean
  Temperatures: double
  Override_MC_Flow_Rate: boolean
  MC_Flow_Rate: double
  Override_Batt_Flow_Rate: boolean
  Batt_Flow_Rate: double
  Override_HIB_ON: boolean
  HIB_ON: boolean
  Override_HUDL_ON: boolean
  HUDL_ON: boolean
  Override_TMS_ON: boolean
  TMS_ON: boolean
  Override_GUB_ON: boolean
  GUB_ON: boolean
  Override_Acc_ON: boolean
  Acc_ON: boolean
  Override_Batt_12V_ON: boolean
  Batt_12V_ON: boolean
  Override_Vicor_Current: boolean
  Vicor_Current: double
  Override_LVSS_Temps: boolean
  LVSS_Temps: double
  Override_LVSS_Currents: boolean
  LVSS_Currents: double
  Override_Heartbeats: boolean
  Heartbeats: double
  Override_MC_12V0: boolean
  MC_12V0: boolean
  Override_LVSS_EN: boolean
  LVSS_EN: boolean
  Override_nReset: boolean
  nReset: boolean
  Override_Self_Test: boolean
  Self_Test: double
  Override_Watchdog: boolean
  Watchdog: boolean
  Override_uC_State: boolean
  uC_State: Enum: UC_State
  Override_HB_Feedback: boolean
  HB_Feedback: boolean
  Override_HM_Fault: boolean
  HM_Fault: boolean
  Direction_Command: int16
  Override_Direction_Command: boolean
  Rolling_Counter: int16
  Override_Rolling_Counter: boolean
  Speed_Command: int16
  Override_Speed_Command: boolean
  Speed_Mode_Enable: int16
  Override_Speed_Mode_Enable: boolean
  Torque_Limit_Command: int16
  Override_Torque_Limit_Command: boolean
  LS_Self_Test: boolean
  Override_LS_Self_Test: boolean
  MC_Self_Test: boolean
  Override_MC_Self_Test: boolean
  CAN_Self_Test: boolean
  Override_CAN_Self_Test: boolean
  LVSS_EN_Override: boolean
  Override_LVSS_EN_Override: boolean
  MC_EN_Override: boolean
  Override_MC_EN_Override: boolean
  CAN_Override: boolean
  Override_CAN_Override: boolean
  Front_Wheel_Speed: double
  Override_Front_Wheel_Speed: boolean
  Back_Wheel_Speed: double
  Override_Back_Wheel_Speed: boolean
  Wheel_Speed: double
  Override_Wheel_Speed: boolean

Rider_Inputs_VCU = Simulink.Bus()
  Key_In: Bus: Key_In
  Estop_In: Bus: Estop_In
  Brake: boolean
  Forward_EN: boolean
  Start: boolean
  Throttle: int16

Feedback = Simulink.Bus()
  MC_Feedback: Bus: MC_Feedback
  LVSS_Feedback: Bus: LVSS_Feedback
  Internal_Feedback: Bus: Internal_Feedback
  BMS_Feedback: Bus: BMS_Feedback
  GFDB_Feedback: Bus: GFDB_Feedback
  TMS_Feedback: Bus: TMS_Feedback
  Heartbeats: single[1 6]
  LS_Self_Test: Bus: LS_Self_Test

Hardmon_Inputs = Simulink.Bus()
  Rider_Inputs: Bus: Rider_Inputs_VCU
  Feedback: Bus: Feedback
  HIB: Bus: VCU_HIB
  Interlock: boolean
  MC_Direction_Command: double
  MC_Rolling_Counter: double
  MC_Speed_Command: double
  MC_Speed_Mode_Enable: double
  MC_Torque_Limit_Command: double

Sig4 = Simulink.Signal()
Sig5 = Simulink.Signal()
Sig6 = Simulink.Signal()